# Grasshopper definition arabia_a.gh (Grasshopper 1.0.4)

座面飾り波形深さ = Slider(3, range=1..3, expression="x*10")
座面飾り高さ = Slider(3, range=1..3, expression="x*100")
手すり位置 = Slider(2, range=1..2, expression="x*0.5")
手すり高さ = Slider(3, range=1..3, expression="x*50")
基本奥行 = Slider(3, range=2..3, expression="x*200")
座面高さ = Slider(5, range=4..5, expression="x*100")
波数 = Slider(7, range=3..7)
基本幅 = Slider(8, range=4..8, expression="x*100")
rectangle = Rectangle(Plane=PlaneXY(0, 0, 0), XSize=基本幅, YSize=基本奥行, Radius=0)  # -> Rectangle, Length
pi = Pi(Factor=波数)
dom = ConstructDomain(DomainStart=0, DomainEnd=pi)
debrep = DeconstructBrep(Brep=rectangle.Rectangle)  # -> Faces, Edges, Vertices
subtraction = Subtraction(A=座面高さ, B=座面飾り高さ)
rec = Rectangle({Plane=PlaneXY(-10, -10, 0), Size=Domain2(u=0..20, v=0..20)})
pt = Point(debrep.Vertices)
range = Range(Domain=dom, Steps="30")
Z = UnitZ(Factor=座面高さ)
orient = Orient(Geometry=rec, Source=PlaneXY(0, 0, 0), Target=pt)  # -> Geometry, Transform
Z_2 = UnitZ(Factor=座面高さ)
t = Expression(A=座面飾り波形深さ, t=range, Expression="A*sin(t)")
divide = DivideCurve(Curve=debrep.Edges, Count="30", Kinks=False)  # -> Points, Tangents, Parameters
move = Move(Geometry=debrep.Edges, Motion=Z)  # -> graft(Geometry), Transform
pdecon = Deconstruct(Point=divide.Points)  # -> XComponent, YComponent, ZComponent
extr = Extrude(Base=orient.Geometry, Direction=Z_2)
item = ListItem(List=debrep.Faces, Index=0, Wrap=True)
Z_3 = UnitZ(Factor=座面高さ)
pt_2 = ConstructPoint(XCoordinate=pdecon.XComponent, YCoordinate=pdecon.YComponent, ZCoordinate=t)
move_2 = Move(Geometry=item, Motion=Z_3)  # -> Geometry, Transform
Z_4 = UnitZ(Factor="30")
graft = GraftTree(Tree=move.Geometry, IncludeEmptyLists=True, IncludeNullItems=True)
Z_5 = UnitZ(Factor=subtraction)
intcrv = Interpolate(Vertices=pt_2, Degree=3, Periodic=False, KnotStyle=1)  # -> Curve, Length, Domain
extr_2 = Extrude(Base=move_2.Geometry, Direction=Z_4)
debrep_2 = DeconstructBrep(Brep=move_2.Geometry)  # -> Faces, Edges, Vertices
move_3 = Move(Geometry=intcrv.Curve, Motion=Z_5)  # -> Geometry, Transform
cap = CapHoles(Brep=extr)
item_2 = ListItem(List=debrep_2.Edges, Index=0, Wrap=True)  # -> Item, Item1, Item2, Item3
item_3 = ListItem(List=debrep_2.Vertices, Index=0, Wrap=True)  # -> Item, Item1, Item2, Item3
rulesrf = RuledSurface(CurveA=graft, CurveB=move_3.Geometry)
pt_3 = Point(item_3.Item2)
pt_4 = Point(item_3.Item3)
sunion = SolidUnion(Breps=rulesrf)
ln = Line(StartPoint=pt_3, EndPoint=pt_4)
offset = Offset(Surface=sunion, Distance="-10", Retrim=True)
mid = TK_MidPoint(C=ln)  # -> P
# ---------- mid: Python ----------
import rhinoscriptsyntax as rs

if C!=None:
    P=rs.CurveMidPoint(C)
else:
    P=None
# ---------- end mid ----------
loft = Loft(
    Curves=[rulesrf, offset],
    Options={Adjust=False, Closed=False, LoftEnds=0, LoftSimp=0, LoftType=0, Rebuild=10, Refit=0.01})
line = Line(item_2.Item1)
line_2 = Line(item_2.Item3)
join = BrepJoin(Breps=[rulesrf, offset, loft])  # -> flatten(Breps), Closed
end = EndPoints(Curve=line)  # -> Start, End
subtraction_2 = Subtraction(A=1, B=手すり位置)
eval = EvaluateCurve(Curve=line_2, Parameter=手すり位置)  # -> Point, Tangent, Angle
pt_5 = Point(end.End)
eval_2 = EvaluateCurve(Curve=line, Parameter=subtraction_2)  # -> Point, Tangent, Angle
pt_6 = Point(eval_2.Point)
orient_2 = Orient(Geometry=rec, Source=PlaneXY(0, 0, 0), Target=[pt_3, mid, pt_4])  # -> Geometry, Transform
Z_6 = UnitZ(Factor=座面高さ)
trim = TrimSolid(Shape=join.Breps, Cutters=cap)
Z_7 = UnitZ(Factor=1)
ln_2 = Line(StartPoint=pt_5, EndPoint=pt_6)
line_3 = LineSDL(Start=[eval_2.Point, eval.Point], Direction=Z_7, Length=手すり高さ)
len = Length(Curve=ln_2)
extr_3 = Extrude(Base=orient_2.Geometry, Direction=Z_6)
end_2 = EndPoints(Curve=line_3)  # -> Start, End
cap_2 = CapHoles(Brep=extr_3)
Y = UnitY(Factor=1)
pt_7 = Point(end_2.End)
item_4 = ListItem(List=cap_2, Index=0, Wrap=True)  # -> Item, Item1, Item2
line_4 = LineSDL(Start=pt_7, Direction=Y, Length=len)
brep = Brep(item_4.Item)
brep_2 = Brep(item_4.Item2)
pipe = Pipe(Curve=[line_4, line_3], Radius="10", Caps=2)
debrep_3 = DeconstructBrep(Brep=brep)  # -> Faces, Edges, Vertices
debrep_4 = DeconstructBrep(Brep=brep_2)  # -> Faces, Edges, Vertices
item_5 = ListItem(List=debrep_3.Vertices, Index="2", Wrap=True)
item_6 = ListItem(List=debrep_4.Vertices, Index="1", Wrap=True)
ln_3 = Line(StartPoint=item_5, EndPoint=item_6)
xz = XZPlane(Origin=item_6)
len_2 = Length(Curve=ln_3)
rectangle_2 = Rectangle(Plane=xz, XSize=len_2, YSize="-150", Radius=0)  # -> Rectangle, Length
Y_2 = UnitY(Factor=expr("x*-1", "10"))
boundary = BoundarySurfaces(Edges=rectangle_2.Rectangle)
extr_4 = Extrude(Base=boundary, Direction=Y_2)
debrep_5 = DeconstructBrep(Brep=extr_4)  # -> Faces, Edges, Vertices
item_7 = ListItem(List=debrep_5.Faces, Index="5", Wrap=True)
faceb = FaceBoundaries(Mesh=item_7)
offset_2 = Offset(Curve=faceb, Distance="-15", Plane=PlaneXY(0, 0, 0), Corners=1)
Y_3 = UnitY(Factor=expr("x*-1", "10"))
boundary_2 = BoundarySurfaces(Edges=offset_2)
extr_5 = Extrude(Base=boundary_2, Direction=Y_3)

brep_3 = Brep(<brep referenced from the Rhino model>)  # disabled
bbox = BoundingBox(Content=brep_3, Plane=PlaneXY(0, 0, 0))  # -> Box, Box_2; disabled
debrep_6 = DeconstructBrep(Brep=bbox.Box)  # -> Faces, Edges, Vertices; disabled
panel = Panel(debrep_6.Vertices)  # disabled

brep_4 = Brep(pipe)
brep_5 = Brep(extr_2)
brep_6 = Brep(extr_4)
brep_7 = Brep(extr_5)
brep_8 = Brep(trim)
brep_9 = Brep(cap)
brep_10 = Brep(cap_2)
merge = Merge(Data1=brep_8, Data2=brep_9, Data3=brep_4, Data4=brep_5, Data5=brep_6, Data6=brep_7, Data7=brep_10)
