# Grasshopper definition arabia_b.gh (Grasshopper 1.0.4)

背もたれ上端高さ = Slider(6, range=2..6, expression="x*100")
脚形状変化_1 = Slider(4, range=0..4, expression="x*50")
脚形状変化_2 = Slider(0, range=-2..0, expression="x*50")
基本幅 = Slider(6, range=4..6, expression="x*100")
奥行き = Slider(8, range=4..8, expression="x*100")
addition = Addition(A=脚形状変化_1, B=-50)
addition_2 = Addition(A=脚形状変化_2, B=-50)
pt = ConstructPoint(XCoordinate=脚形状変化_1, YCoordinate=0, ZCoordinate="200")
pt_2 = ConstructPoint(XCoordinate=脚形状変化_2, YCoordinate=0, ZCoordinate="400")
pt_3 = ConstructPoint(XCoordinate=addition, YCoordinate=0, ZCoordinate="200")
pt_4 = ConstructPoint(XCoordinate=addition_2, YCoordinate=0, ZCoordinate="400")
pt_5 = Point(Point(0, 0, 0))
pt_6 = Point(pt)
pt_7 = Point(pt_2)
pt_8 = Point(Point(0, 0, 600))
pt_9 = Point(Point(-20, 0, 0))
pt_10 = Point(pt_3)
pt_11 = Point(pt_4)
pt_12 = Point(Point(-62, 0, 600))
X = UnitX(Factor=1)
line = LineSDL(Start=pt_5, Direction=X, Length=基本幅)
intcrv = Interpolate(Vertices=[pt_9, pt_10, pt_11, pt_12], Degree=3, Periodic=False, KnotStyle=1)  # -> Curve, Length, Domain
intcrv_2 = Interpolate(Vertices=[pt_5, pt_6, pt_7, pt_8], Degree=3, Periodic=False, KnotStyle=1)  # -> Curve, Length, Domain
mid = TK_MidPoint(C=line)  # -> P
# ---------- mid: Python ----------
import rhinoscriptsyntax as rs

if C!=None:
    P=rs.CurveMidPoint(C)
else:
    P=None
# ---------- end mid ----------
crv_cp = CurveClosestPoint(Point=pt_12, Curve=intcrv_2.Curve)  # -> Point, Parameter, Distance
xz = XZPlane(Origin=pt_12)
yz = YZPlane(Origin=mid)
intcrv_3 = Interpolate(Vertices=[pt_5, pt_6, pt_7, crv_cp.Point], Degree=3, Periodic=False, KnotStyle=1)  # -> Curve, Length, Domain
ln = Line(StartPoint=pt_12, EndPoint=crv_cp.Point)
len = Length(Curve=ln)
cir = Circle(Plane=xz, Radius=len)
loft = Loft(
    Curves=[intcrv_3.Curve, intcrv.Curve],
    Options={Adjust=False, Closed=False, LoftEnds=0, LoftSimp=0, LoftType=0, Rebuild=10, Refit=0.01})
circle = Circle(cir)
boundary = BoundarySurfaces(Edges=circle)
rdiff = RegionDifference(CurvesA=loft, CurvesB=boundary)
boundary_2 = BoundarySurfaces(Edges=rdiff)
join = BrepJoin(Breps=[boundary_2, boundary])  # -> Breps, Closed
debrep = DeconstructBrep(Brep=boundary_2)  # -> Faces, Edges, Vertices
Y = UnitY(Factor=奥行き)
item = ListItem(List=debrep.Edges, Index="5", Wrap=True)
mirror = Mirror(Geometry=join.Breps, Plane=yz)  # -> Geometry, Transform
mirror_2 = Mirror(Geometry=item, Plane=yz)  # -> Geometry, Transform
loft_2 = Loft(
    Curves=[item, mirror_2.Geometry],
    Options={Adjust=False, Closed=False, LoftEnds=0, LoftSimp=0, LoftType=0, Rebuild=10, Refit=0.01})
brep = Brep(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)
brep_2 = Brep(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)
split = SplitBrep(Brep=loft_2, Cutter=graft(brep))
item_2 = ListItem(List=split, Index=0, Wrap=True)
split_2 = SplitBrep(Brep=item_2, Cutter=graft(brep_2))
item_3 = ListItem(List=split_2, Index=0, Wrap=True)  # -> Item, Item1
srf = Surface(item_3.Item1)
srf_2 = Surface(item_3.Item)
Y_2 = UnitY(Factor="100")
subtraction = Subtraction(A=奥行き, B="100")
extr = Extrude(Base=srf_2, Direction=Y_2)
Y_3 = UnitY(Factor=subtraction)
debrep_2 = DeconstructBrep(Brep=extr)  # -> Faces, Edges, Vertices
item_4 = ListItem(List=debrep_2.Faces, Index=1, Wrap=True)
Z = UnitZ(Factor=背もたれ上端高さ)
extr_2 = Extrude(Base=[item_4, extr], Direction=Z)
move = Move(Geometry=extr_2, Motion=Y_3)  # -> Geometry, Transform

brep_3 = Brep(<brep referenced from the Rhino model>)  # disabled
bbox = BoundingBox(Content=brep_3, Plane=PlaneXY(0, 0, 0))  # -> Box, Box_2; disabled
debrep_3 = DeconstructBrep(Brep=bbox.Box)  # -> Faces, Edges, Vertices; disabled
panel = Panel(debrep_3.Vertices)  # disabled

extr_3 = Extrude(Base=[join.Breps, mirror.Geometry, srf, move.Geometry], Direction=Y)
