# Grasshopper definition arabia_c.gh (Grasshopper 0.9.76)
# plug-ins: Python Interpreter

基本幅_奥 = Slider(0, range=0..2, expression="x*50")
背もたれ反り = Slider(1, range=0..1, expression="x*100")
背もたれ本数 = Slider(5, range=2..5)
脚径 = Slider(3, range=1..3, expression="x*10")
背もたれ高 = Slider(4, range=4..6, expression="x*100")
背もたれ高_2 = Slider(2, range=1..3, expression="x*100")
座面高さ = Slider(4, range=4..5, expression="x*100")
基本幅 = Slider(2, range=2..5, expression="x*200")
division = Division(A=脚径, B=-2)
vec = VectorXYZ(XComponent=division, YComponent=division, ZComponent=0)  # -> Vector, Length
rectangle = Rectangle(Plane=vec.Vector, XSize=脚径, YSize=脚径, Radius=0)  # -> Rectangle, Length
subtraction = Subtraction(A=基本幅, B=基本幅_奥)
pt = ConstructPoint(XCoordinate=基本幅, YCoordinate=0, ZCoordinate=0)
pt_2 = ConstructPoint(XCoordinate=基本幅_奥, YCoordinate="400", ZCoordinate=0)
pt_3 = ConstructPoint(XCoordinate=subtraction, YCoordinate="400", ZCoordinate=0)
pt_4 = Point("0,0,0")
Z = UnitZ(Factor=1)
pt_5 = Point([pt_2, pt_3])
line = LineSDL(Start=[pt_4, pt, pt_2, pt_3], Direction=Z, Length=座面高さ)
devec = DeconstructVector(Vector=pt_5)  # -> XComponent, YComponent, ZComponent
devec_2 = DeconstructVector(Vector=pt_5)  # -> XComponent, YComponent, ZComponent
end = EndPoints(Curve=line)  # -> Start, End
pt_6 = Point(end.End)
addition = Addition(A=座面高さ, B=背もたれ高)
addition_2 = Addition(A=devec_2.YComponent, B=背もたれ反り)
item = ListItem(List=pt_6, Index=0, Wrap=True)  # -> Item, Item1, Item2, Item3
vec_2 = VectorXYZ(XComponent=devec.XComponent, YComponent=devec.YComponent, ZComponent=座面高さ)  # -> Vector, Length
vec_3 = VectorXYZ(XComponent=devec_2.XComponent, YComponent=addition_2, ZComponent=addition)  # -> Vector, Length
pline = PolyLine(Vertices=[item.Item, item.Item1, item.Item3, item.Item2], Closed=True)
pt_7 = Point(vec_2.Vector)
pt_8 = Point(vec_3.Vector)
offset = Offset(Curve=pline, Distance=脚径, Plane=PlaneXY(0, 0, 0), Corners=1)
Z_2 = UnitZ(Factor=脚径)
ln = Line(StartPoint=pt_7, EndPoint=pt_8)
boundary = BoundarySurfaces(Edges=offset)
end_2 = EndPoints(Curve=ln)  # -> Start, End
eval = EvaluateCurve(Curve=ln, Parameter="0")  # -> Point, Tangent, Angle
pt_9 = Point(end_2.End)
pframe = PerpFrame(Curve=ln, Parameter="1")
item_2 = ListItem(List=pt_9, Index=0, Wrap=True)  # -> Item, Item1
deplane = DeconstructPlane(Plane=pframe)  # -> Origin, XAxis, YAxis, ZAxis
pl = ConstructPlane(Origin=item_2.Item, XAxis=deplane.YAxis, YAxis=eval.Tangent)
ln_2 = Line(StartPoint=item_2.Item, EndPoint=item_2.Item1)
orient = Orient(Geometry=rectangle.Rectangle, Source=PlaneXY(0, 0, 0), Target=pl)  # -> Geometry, Transform
ext = ExtendCurve(Curve=ln_2, Type=0, Start=脚径, End=脚径)
end_3 = EndPoints(Curve=ext)  # -> Start, End
extrude = ExtrudeLinear(Profile=orient.Geometry, OrientationP=item_2.Item, Axis=ext, OrientationA=end_3.Start)
multiplication = Multiplication(A=脚径, B=0.5)
unit = UnitVector(Vector=eval.Tangent)
cap = CapHoles(Brep=extrude)
amp = Amplitude(Vector=unit, Amplitude=multiplication)
division_2 = Division(A=脚径, B=-4)
geo = Geometry(rectangle.Rectangle)

mid = TK_MidPoint(C=line)  # -> P
# ---------- mid: Python ----------
import rhinoscriptsyntax as rs

if C!=None:
    P=rs.CurveMidPoint(C)
else:
    P=None
# ---------- end mid ----------
item_3 = ListItem(List=mid, Index=0, Wrap=True)  # -> Item, Item1, Item2, Item3
ln_3 = Line(StartPoint=item_3.Item, EndPoint=item_3.Item2)
ln_4 = Line(StartPoint=item_3.Item1, EndPoint=item_3.Item3)
mid_2 = TK_MidPoint(C=ln_3)  # -> P; same code as mid
mid_3 = TK_MidPoint(C=ln_4)  # -> P; same code as mid
ln_5 = Line(StartPoint=mid_2, EndPoint=mid_3)
xz = XZPlane(Origin=item_3.Item)
xz_2 = XZPlane(Origin=item_3.Item1)
yz = YZPlane(Origin=mid_2)
orient_2 = Orient(Geometry=rectangle.Rectangle, Source=PlaneXY(0, 0, 0), Target=xz)  # -> Geometry, Transform
orient_3 = Orient(Geometry=rectangle.Rectangle, Source=PlaneXY(0, 0, 0), Target=xz_2)  # -> Geometry, Transform
orient_4 = Orient(Geometry=rectangle.Rectangle, Source=PlaneXY(0, 0, 0), Target=yz)  # -> Geometry, Transform
Y = UnitY(Factor="400")
X = UnitX(Factor=基本幅)
extr = Extrude(Base=[orient_2.Geometry, orient_3.Geometry], Direction=Y)
extr_2 = Extrude(Base=orient_4.Geometry, Direction=X)
join = BrepJoin(Breps=[extr, extr_2])  # -> Breps, Closed

offset_2 = Offset(Curve=geo, Distance=division_2, Plane=PlaneXY(0, 0, 0), Corners=1)
extrude_2 = ExtrudeLinear(Profile=rectangle.Rectangle, OrientationP=PlaneXY(0, 0, 0), Axis=ln)
extrude_3 = ExtrudeLinear(Profile=rectangle.Rectangle, OrientationP=PlaneXY(0, 0, 0), Axis=line)
move = Move(Geometry=cap, Motion=amp)  # -> Geometry, Transform
extr_3 = Extrude(Base=boundary, Direction=Z_2)
item_4 = ListItem(List=extrude_2, Index=0, Wrap=True)  # -> Item, Item1
debrep = DeconstructBrep(Brep=extr_3)  # -> Faces, Edges, Vertices
debrep_2 = DeconstructBrep(Brep=item_4.Item)  # -> Faces, Edges, Vertices
debrep_3 = DeconstructBrep(Brep=item_4.Item1)  # -> Faces, Edges, Vertices
item_5 = ListItem(List=debrep.Faces, Index="6", Wrap=True)
item_6 = ListItem(List=debrep_2.Faces, Index=4, Wrap=True)
item_7 = ListItem(List=debrep_3.Faces, Index=2, Wrap=True)
split = SplitBrep(Brep=extrude_2, Cutter=item_5)
item_8 = ListItem(List=split, Index=0, Wrap=True)  # -> flatten(Item)
c_script = CSharpScript(folder="C:\ParametricImages\", makeimages=Button())  # -> out, A; inputs folder: String, makeimages: Boolean
# ---------- c_script: C# ----------
    if (!makeimages)
      return;

    if (_running)
      return;

    if (!System.IO.Directory.Exists(folder))
      System.IO.Directory.CreateDirectory(folder);

    _folder = folder;
    _run = true;
    GrasshopperDocument.SolutionEnd += OnSolutionEnd;
# ---------- c_script: C# additional code ----------
  private bool _run = false;
  private bool _running = false;
  private string _folder;

  private void OnSolutionEnd(object sender, GH_SolutionEventArgs e)
  {
    // Unregister the event, we don't want to get called again.
    e.Document.SolutionEnd -= OnSolutionEnd;

    // If we're not supposed to run, abort now.
    if (!_run)
      return;

    // If we're already running, abort now.
    if (_running)
      return;

    // Reset run and running states.
    _run = false;
    _running = true;

    try
    {
      // Find all sliders.
      List<Grasshopper.Kernel.Special.GH_NumberSlider> sliders = new List<Grasshopper.Kernel.Special.GH_NumberSlider>();
      foreach (IGH_DocumentObject docObject in GrasshopperDocument.Objects)
      {
        Grasshopper.Kernel.Special.GH_NumberSlider slider = docObject as Grasshopper.Kernel.Special.GH_NumberSlider;
        if (slider == null)
          continue;
        sliders.Add(slider);
      }
      if (sliders.Count == 0)
      {
        System.Windows.Forms.MessageBox.Show("No sliders could be found", "<harsh buzzing sound>", MessageBoxButtons.OK);
        return;
      }

      // Set all sliders back to zero.
      //GH_Document.EnableSolutions = false;
      foreach (Grasshopper.Kernel.Special.GH_NumberSlider slider in sliders)
        slider.TickValue = 0;

      // Start a giant loop in which we'll permutate our way across all slider layouts.
      int imageNumber = 0;
      while (true)
      {
        int idx = 0;
        if (!MoveToNextPermutation(ref idx, sliders))
          break;

        // We've just got a new valid permutation. Solve the new solution.
        e.Document.NewSolution(false);
        Rhino.RhinoDoc.ActiveDoc.Views.Redraw();

        Rhino.Display.RhinoView view = RhinoDocument.Views.Find("Perspective", false);
        if (view == null)
          break;

        string fileName = string.Format("{0}\\{1}.png", _folder, imageNumber);
        imageNumber++;

        Bitmap image = view.CaptureToBitmap();
        if (image == null)
          continue;

        image.Save(fileName);
        image.Dispose();
        image = null;
      }
    }
    catch(Exception ex)
    {
      // Ehm, exception, best swallow it here lest it totally crashes everything.
    }
    finally
    {
      // Always make sure that _running is switched off.
      _running = false;
    }
  }

  private bool MoveToNextPermutation(ref int index, List<Grasshopper.Kernel.Special.GH_NumberSlider> sliders)
  {
    if (index >= sliders.Count)
      return false;

    Grasshopper.Kernel.Special.GH_NumberSlider slider = sliders[index];
    if (slider.TickValue < slider.TickCount)
    {
      // Increment the slider.
      slider.TickValue++;
      return true;
    }
    else
    {
      // The current slider is already at the maximum value. Reset it back to zero.
      slider.TickValue = 0;

      // Move on to the next slider.
      index++;

      // If we've run out of sliders to modify, we're done permutatin'
      if (index >= sliders.Count)
        return false;

      return MoveToNextPermutation(ref index, sliders);
    }
  }
# ---------- end c_script ----------

pt_10 = Point(end_2.Start)
item_9 = ListItem(List=pt_10, Index=0, Wrap=True)  # -> Item, Item1
ln_6 = Line(StartPoint=item_9.Item, EndPoint=item_9.Item1)
item_10 = ListItem(List=ln, Index=0, Wrap=True)
unit_2 = UnitVector(Vector=item_10)
crv = Curve(ln_2)
multiplication_2 = Multiplication(A=unit_2, B=背もたれ高_2)
divide = DivideCurve(Curve=crv, Count=背もたれ本数, Kinks=False)  # -> Points, Tangents, Parameters
move_2 = Move(Geometry=ln_6, Motion=multiplication_2)  # -> Geometry, Transform
end_4 = EndPoints(Curve=move_2.Geometry)  # -> Start, End
geo_2 = Geometry(orient.Geometry)
divide_2 = DivideCurve(Curve=move_2.Geometry, Count=背もたれ本数, Kinks=False)  # -> Points, Tangents, Parameters
area = Area(Geometry=geo_2)  # -> Area, Centroid
lng = ListLength(List=divide_2.Points)
lng_2 = ListLength(List=divide.Points)
vec2pt = Vector2Pt(PointA=area.Centroid, PointB=end_4.Start, Unitize=False)  # -> Vector, Length
subtraction_2 = Subtraction(A=lng, B=2)
subtraction_3 = Subtraction(A=lng_2, B=2)
move_3 = Move(Geometry=geo_2, Motion=vec2pt.Vector)  # -> Geometry, Transform
dom = ConstructDomain(DomainStart=1, DomainEnd=subtraction_2)
dom_2 = ConstructDomain(DomainStart=1, DomainEnd=subtraction_3)
extrude_4 = ExtrudeLinear(Profile=move_3.Geometry, OrientationP=move_3.Geometry, Axis=move_2.Geometry, OrientationA=move_3.Geometry)
subset = SubList(List=divide_2.Points, Domain=dom, Wrap=True)  # -> List, Index
subset_2 = SubList(List=divide.Points, Domain=dom_2, Wrap=True)  # -> List, Index
debrep_4 = DeconstructBrep(Brep=extrude_4)  # -> Faces, Edges, Vertices
item_11 = ListItem(List=debrep_4.Faces, Index="3", Wrap=True)
ln_7 = Line(StartPoint=subset.List, EndPoint=subset_2.List)
split_2 = SplitBrep(Brep=extrude_4, Cutter=item_7)  # -> flatten(Result)
item_12 = ListItem(List=split_2, Index=1, Wrap=True)  # -> flatten(Item)
split_3 = SplitBrep(Brep=item_12, Cutter=item_6)  # -> flatten(Result)
item_13 = ListItem(List=split_3, Index=1, Wrap=True)  # -> flatten(Item)

rev = ReverseList(List=subset_2.List)
rev_2 = ReverseList(List=subset.List)
item_14 = ListItem(List=subset.List, Index=0, Wrap=True)
item_15 = ListItem(List=rev, Index=0, Wrap=True)
item_16 = ListItem(List=subset_2.List, Index=0, Wrap=True)
item_17 = ListItem(List=rev_2, Index=0, Wrap=True)
ln_8 = Line(StartPoint=item_14, EndPoint=item_15)
ln_9 = Line(StartPoint=item_16, EndPoint=item_17)
pframe_2 = PerpFrame(Curve=ln_8, Parameter=0)
pframe_3 = PerpFrame(Curve=ln_9, Parameter=0)
geo_3 = Geometry(offset_2)
geo_4 = Geometry(offset_2)
orient_5 = Orient(Geometry=geo_3, Source=PlaneXY(0, 0, 0), Target=pframe_2)  # -> Geometry, Transform
orient_6 = Orient(Geometry=geo_4, Source=PlaneXY(0, 0, 0), Target=pframe_3)  # -> Geometry, Transform
extrude_5 = ExtrudeLinear(Profile=orient_5.Geometry, OrientationP=orient_5.Geometry, Axis=ln_8, OrientationA=pframe_2)
extrude_6 = ExtrudeLinear(Profile=orient_6.Geometry, OrientationP=orient_6.Geometry, Axis=ln_9, OrientationA=pframe_3)
join_2 = BrepJoin(Breps=[extrude_5, extrude_6])  # -> Breps, Closed

extrude_7 = ExtrudeLinear(Profile=offset_2, OrientationP=PlaneXY(0, 0, 0), Axis=ln_7, OrientationA=subset.List)

split_4 = SplitBrep(Brep=extrude_7, Cutter=item_11)
item_18 = ListItem(List=split_4, Index=1, Wrap=True)  # -> flatten(Item)

join_3 = BrepJoin(Breps=[move.Geometry, extrude_3, extr_3, item_8, item_18, item_13, join_2.Breps, join.Breps])  # -> Breps, Closed
