# Grasshopper definition chinese_b.gh (Grasshopper 1.0.4)
# plug-ins: MeshEdit Components, Weaverbird

座面高さ = Slider(5, range=4..5, expression="x*100")
脚太さ_座面厚み = Slider(4, range=2..4, expression="x*10")
背もたれ抜き高さ = Slider(4, range=1..4, expression="x*0.2")
背もたれ上端高さ = Slider(6, range=4..6, expression="x*100")
背もたれ抜き幅 = Slider(2, range=0..5, expression="x*0.2")
基本奥行 = Slider(3, range=2..3, expression="x*200")
基本幅 = Slider(5, range=2..5, expression="x*200")
vec = VectorXYZ(XComponent=基本幅, YComponent=基本奥行, ZComponent=座面高さ)  # -> Vector, Length
division = Division(A=脚太さ_座面厚み, B=-2)
pt = Point(Point(0, 0, 0))
pt_2 = ConstructPoint(XCoordinate=division, YCoordinate=division, ZCoordinate=0)
box = Box2Pt(PointA=pt, PointB=vec.Vector, Plane=PlaneXY(0, 0, 0))
mesh = MeshBrep(
    Brep=box,
    Settings={GridMaxCount=0, GridMinCount=16, JaggedSeams=False, MaxEdgeLength=0, MinEdgeLength=0.0001, MinTolerance=0, Refine=True, RefineAngle=0, RelativeTolerance=0.65, SimplePlanes=True, Tolerance=0})
rectangle = Rectangle(Plane=pt_2, XSize=脚太さ_座面厚み, YSize=脚太さ_座面厚み, Radius=0)  # -> Rectangle, Length
wbedges = WeaverbirdsMeshEdges(MeshOrPolylines=mesh)
explode = MeshExplode(Mesh=mesh, Interpolate=False)
panel = Panel("""0
2
5
8""")
item = ListItem(List=explode, Index="4", Wrap=True)  # -> Item, Item1
item_2 = ListItem(List=wbedges, Index=panel, Wrap=True)
mesh_2 = Mesh(item.Item)
orient = Orient(Geometry=rectangle.Rectangle, Source=PlaneXY(0, 0, 0), Target=item_2)  # -> Geometry, Transform
extrude = ExtrudeLinear(Profile=orient.Geometry, OrientationP=orient.Geometry, Axis=item_2, OrientationA=orient.Geometry)
wbedges_2 = WeaverbirdsMeshEdges(MeshOrPolylines=mesh_2)
Z = UnitZ(Factor="50")
join = JoinCurves(Curves=wbedges_2, Preserve=False)
Z_2 = UnitZ(Factor=座面高さ)
move = Move(Geometry=join, Motion=Z)  # -> Geometry, Transform
multiplication = Multiplication(A=脚太さ_座面厚み, B=0.5)
multiplication_2 = Multiplication(A=脚太さ_座面厚み, B=-0.5)
multiplication_3 = Multiplication(A=脚太さ_座面厚み, B=-0.5)
move_2 = Move(Geometry=join, Motion=Z_2)  # -> Geometry, Transform
join_2 = JoinCurves(Curves=move_2.Geometry, Preserve=False)
offset = Offset(Curve=move.Geometry, Distance=graft([multiplication, multiplication_2]), Plane=PlaneXY(0, 0, 0), Corners=1)
offset_2 = Offset(Curve=join_2, Distance=multiplication_3, Plane=PlaneXY(0, 0, 0), Corners=1)
bang = ExplodeTree(Data=offset)  # -> _0000, _0010
boundary = BoundarySurfaces(Edges=offset_2)
Z_3 = UnitZ(Factor=脚太さ_座面厚み)
boundary_2 = BoundarySurfaces(Edges=flatten([bang._0000, bang._0010]))
Z_4 = UnitZ(Factor=脚太さ_座面厚み)
extr = Extrude(Base=boundary, Direction=Z_3)
extr_2 = Extrude(Base=boundary_2, Direction=Z_4)
debrep = DeconstructBrep(Brep=extr)  # -> Faces, Edges, Vertices
item_3 = ListItem(List=debrep.Vertices, Index="9", Wrap=True)  # -> Item, Item1
Z_5 = UnitZ(Factor=背もたれ上端高さ)
move_3 = Move(Geometry=[item_3.Item, item_3.Item1], Motion=Z_5)  # -> Geometry, Transform
item_4 = ListItem(List=move_3.Geometry, Index=0, Wrap=True)  # -> Item, Item1
division_2 = Division(A=脚太さ_座面厚み, B=2)
ln = Line(StartPoint=item_3.Item, EndPoint=item_3.Item1)
X = UnitX(Factor=division_2)
mid = TK_MidPoint(C=ln)  # -> P
# ---------- mid: Python ----------
import rhinoscriptsyntax as rs

if C!=None:
    P=rs.CurveMidPoint(C)
else:
    P=None
# ---------- end mid ----------
cap = CapHoles(Brep=extrude)
trim = TrimSolid(Shape=extr_2, Cutters=cap)
srf4pt = _4PointSurface(CornerA=item_3.Item, CornerB=item_3.Item1, CornerC=item_4.Item1, CornerD=item_4.Item)
ln_2 = Line(StartPoint=item_3.Item, EndPoint=mid)
eval = EvaluateCurve(Curve=ln_2, Parameter=背もたれ抜き幅)  # -> Point, Tangent, Angle
move_4 = Move(Geometry=item_3.Item, Motion=X)  # -> Geometry, Transform
Z_6 = UnitZ(Factor=1)
ln_3 = Line(StartPoint=eval.Point, EndPoint=move_4.Geometry)
xz = XZPlane(Origin=eval.Point)
multiplication_4 = Multiplication(A=背もたれ上端高さ, B=背もたれ抜き高さ)
line = LineSDL(Start=mid, Direction=Z_6, Length=1)
len = Length(Curve=ln_3)  # -> expr("x*-1", Length)
rectangle_2 = Rectangle(Plane=xz, XSize=len, YSize=multiplication_4, Radius=0)  # -> Rectangle, Length
mirror = MirrorCurve(Geometry=rectangle_2.Rectangle, Curve=line, Tangent=True)
crv = Curve(flatten([rectangle_2.Rectangle, mirror]))
rdiff = RegionDifference(CurvesA=srf4pt, CurvesB=crv)
Y = UnitY(Factor=expr("x*(-1)", 脚太さ_座面厚み))
boundary_3 = BoundarySurfaces(Edges=rdiff)

brep = Brep(<brep referenced from the Rhino model>)  # disabled
bbox = BoundingBox(Content=brep, Plane=PlaneXY(0, 0, 0))  # -> Box, Box_2; disabled
number_slider = Slider(6, range=0..20)  # disabled
debrep_2 = DeconstructBrep(Brep=bbox.Box)  # -> Faces, Edges, Vertices; disabled
item_5 = ListItem(List=debrep_2.Vertices, Index=number_slider, Wrap=True)  # disabled

extr_3 = Extrude(Base=boundary_3, Direction=Y)
join_3 = BrepJoin(Breps=[trim, cap, extr, extr_3])  # -> Breps, Closed
