# Grasshopper definition english_c.gh (Grasshopper 0.9.76)

基本幅_奥 = Slider(2, range=0..2, expression="x*50")
背もたれ反り = Slider(2, range=0..2, expression="x*75")
背もたれ本数 = Slider(4, range=1..4, expression="x*2.5")
背もたれ高 = Slider(5, range=3..5, expression="x*100")
脚径 = Slider(3, range=1..3, expression="x*10")
座面高さ = Slider(5, range=3..5, expression="x*100")
基本幅 = Slider(5, range=2..5, expression="x*200")
division = Division(A=脚径, B=-2)
vec = VectorXYZ(XComponent=division, YComponent=division, ZComponent=0)  # -> Vector, Length
rectangle = Rectangle(Plane=vec.Vector, XSize=脚径, YSize=脚径, Radius=0)  # -> Rectangle, Length
subtraction = Subtraction(A=基本幅, B=基本幅_奥)
pt = ConstructPoint(XCoordinate=基本幅, YCoordinate=0, ZCoordinate=0)
pt_2 = ConstructPoint(XCoordinate=基本幅_奥, YCoordinate="400", ZCoordinate=0)
pt_3 = ConstructPoint(XCoordinate=subtraction, YCoordinate="400", ZCoordinate=0)
pt_4 = Point("0,0,0")
Z = UnitZ(Factor=1)
pt_5 = Point([pt_2, pt_3])
line = LineSDL(Start=[pt_4, pt, pt_2, pt_3], Direction=Z, Length=座面高さ)
end = EndPoints(Curve=line)  # -> Start, End
devec = DeconstructVector(Vector=pt_5)  # -> XComponent, YComponent, ZComponent
devec_2 = DeconstructVector(Vector=pt_5)  # -> XComponent, YComponent, ZComponent
pt_6 = Point(end.End)
addition = Addition(A=座面高さ, B=背もたれ高)
addition_2 = Addition(A=devec_2.YComponent, B=背もたれ反り)
item = ListItem(List=pt_6, Index=0, Wrap=True)  # -> Item, Item1, Item2, Item3
pline = PolyLine(Vertices=[item.Item, item.Item1, item.Item3, item.Item2], Closed=True)
vec_2 = VectorXYZ(XComponent=devec.XComponent, YComponent=devec.YComponent, ZComponent=座面高さ)  # -> Vector, Length
vec_3 = VectorXYZ(XComponent=devec_2.XComponent, YComponent=addition_2, ZComponent=addition)  # -> Vector, Length
offset = Offset(Curve=pline, Distance=脚径, Plane=PlaneXY(0, 0, 0), Corners=1)
pt_7 = Point(vec_2.Vector)
pt_8 = Point(vec_3.Vector)
Z_2 = UnitZ(Factor=脚径)
boundary = BoundarySurfaces(Edges=offset)
ln = Line(StartPoint=pt_7, EndPoint=pt_8)
end_2 = EndPoints(Curve=ln)  # -> Start, End
eval = EvaluateCurve(Curve=ln, Parameter="0")  # -> Point, Tangent, Angle
item_2 = ListItem(List=ln, Index=0, Wrap=True)
pt_9 = Point(end_2.Start)
pt_10 = Point(end_2.End)
pframe = PerpFrame(Curve=ln, Parameter="1")
item_3 = ListItem(List=pt_10, Index=0, Wrap=True)  # -> Item, Item1
deplane = DeconstructPlane(Plane=pframe)  # -> Origin, XAxis, YAxis, ZAxis
item_4 = ListItem(List=pt_9, Index=0, Wrap=True)  # -> Item, Item1
pl = ConstructPlane(Origin=item_3.Item, XAxis=deplane.YAxis, YAxis=eval.Tangent)
ln_2 = Line(StartPoint=item_3.Item, EndPoint=item_3.Item1)
ln_3 = Line(StartPoint=item_4.Item, EndPoint=item_4.Item1)
ext = ExtendCurve(Curve=ln_2, Type=0, Start=脚径, End=脚径)
orient = Orient(Geometry=rectangle.Rectangle, Source=PlaneXY(0, 0, 0), Target=pl)  # -> Geometry, Transform
end_3 = EndPoints(Curve=ext)  # -> Start, End
extrude = ExtrudeLinear(Profile=orient.Geometry, OrientationP=item_3.Item, Axis=ext, OrientationA=end_3.Start)
multiplication = Multiplication(A=脚径, B=0.5)
unit = UnitVector(Vector=eval.Tangent)
cap = CapHoles(Brep=extrude)
amp = Amplitude(Vector=unit, Amplitude=multiplication)
divide = DivideCurve(Curve=ln_3, Count=背もたれ本数, Kinks=False)  # -> Points, Tangents, Parameters
lng = ListLength(List=divide.Points)
subtraction_2 = Subtraction(A=lng, B=2)
division_2 = Division(A=脚径, B=-4)
geo = Geometry(rectangle.Rectangle)
dom = ConstructDomain(DomainStart=1, DomainEnd=subtraction_2)
offset_2 = Offset(Curve=geo, Distance=division_2, Plane=PlaneXY(0, 0, 0), Corners=1)
subset = SubList(List=divide.Points, Domain=dom, Wrap=True)  # -> List, Index
extrude_2 = ExtrudeLinear(Profile=offset_2, OrientationP=PlaneXY(0, 0, 0), Axis=item_2, OrientationA=subset.List)
extrude_3 = ExtrudeLinear(Profile=rectangle.Rectangle, OrientationP=PlaneXY(0, 0, 0), Axis=ln)
extrude_4 = ExtrudeLinear(Profile=rectangle.Rectangle, OrientationP=PlaneXY(0, 0, 0), Axis=line)
move = Move(Geometry=cap, Motion=amp)  # -> Geometry, Transform
extr = Extrude(Base=boundary, Direction=Z_2)
debrep = DeconstructBrep(Brep=extr)  # -> Faces, Edges, Vertices
item_5 = ListItem(List=debrep.Faces, Index="6", Wrap=True)

brep = Brep(<brep referenced from the Rhino model>)  # disabled
bbox = BoundingBox(Content=brep, Plane=PlaneXY(0, 0, 0))  # -> Box, Box_2; disabled
number_slider = Slider(6, range=0..20)  # disabled
debrep_2 = DeconstructBrep(Brep=bbox.Box)  # -> Faces, Edges, Vertices; disabled
item_6 = ListItem(List=debrep_2.Vertices, Index=number_slider, Wrap=True)  # disabled

split = SplitBrep(Brep=extrude_3, Cutter=item_5)
split_2 = SplitBrep(Brep=extrude_2, Cutter=item_5)
item_7 = ListItem(List=split, Index=0, Wrap=True)  # -> flatten(Item)
item_8 = ListItem(List=split_2, Index=0, Wrap=True)  # -> flatten(Item)
join = BrepJoin(Breps=[move.Geometry, extrude_4, extr, item_7, item_8])  # -> Breps, Closed
