# Grasshopper definition japan_a.gh (Grasshopper 0.9.76)

背もたれ上端高さ = Slider(10, range=8..10, expression="x*100")
座面オフセット = Slider(5, range=3..5, expression="x*10")
背もたれ高さ = Slider(-1, range=-3..-1, expression="x*100")
基本奥行 = Slider(6, range=3..6, expression="x*100")
座面高さ = Slider(5, range=3..5, expression="x*100")
脚径 = Slider(3, range=1..3, expression="x*10")
基本幅 = Slider(6, range=3..6, expression="x*100")
rectangle = Rectangle(Plane=PlaneXY(0, 0, 0), XSize=基本幅, YSize=基本奥行, Radius=0)  # -> Rectangle, Length
debrep = DeconstructBrep(Brep=rectangle.Rectangle)  # -> Faces, Edges, Vertices
graft = GraftTree(Tree=debrep.Vertices, IncludeEmptyLists=True, IncludeNullItems=True)  # -> simplify(Tree)
cir = Circle(Plane=graft, Radius=脚径)
bang = ExplodeTree(Data=cir)  # -> Branch0, Branch1, Branch2, Branch3
Z = UnitZ(Factor=座面高さ)
move = Move(Geometry=rectangle.Rectangle, Motion=Z)  # -> Geometry, Transform
Z_2 = UnitZ(Factor=座面高さ)
Z_3 = UnitZ(Factor=背もたれ上端高さ)
extr = Extrude(Base=[bang.Branch1, bang.Branch2], Direction=Z_3)
extr_2 = Extrude(Base=[bang.Branch0, bang.Branch3], Direction=Z_2)
offset = Offset(Curve=move.Geometry, Distance=座面オフセット, Plane=PlaneXY(0, 0, 0), Corners=1)
crv = Curve(reparameterize(bang.Branch1))
crv_2 = Curve(reparameterize(bang.Branch2))
Z_4 = UnitZ(Factor="30")
tarc = TangentArcs(CircleA=crv, CircleB=crv_2, Radius="600")  # -> ArcA, ArcB
boundary = BoundarySurfaces(Edges=offset)
Z_5 = UnitZ(Factor=背もたれ上端高さ)
crv_3 = Curve(tarc.ArcA)
Z_6 = UnitZ(Factor=背もたれ高さ)
move_2 = Move(Geometry=crv_3, Motion=Z_5)  # -> Geometry, Transform
move_3 = Move(Geometry=move_2.Geometry, Motion=Z_6)  # -> Geometry, Transform
loft = Loft(
    Curves=[move_2.Geometry, move_3.Geometry],
    Options={Adjust=False, Closed=False, LoftEnds=0, LoftSimp=0, LoftType=0, Rebuild=10, Refit=0.01})
Y = UnitY(Factor="30")
cap = CapHoles(Brep=extr_2)
cap_2 = CapHoles(Brep=extr)
extr_3 = Extrude(Base=boundary, Direction=Z_4)
extr_4 = Extrude(Base=loft, Direction=Y)
brep = Brep([extr_3, cap, cap_2, extr_4])

brep_2 = Brep(<brep referenced from the Rhino model>)  # disabled
bbox = BoundingBox(Content=brep_2, Plane=PlaneXY(0, 0, 0))  # -> Box, Box_2; disabled
number_slider = Slider(6, range=0..20)  # disabled
debrep_2 = DeconstructBrep(Brep=bbox.Box)  # -> Faces, Edges, Vertices; disabled
item = ListItem(List=debrep_2.Vertices, Index=number_slider, Wrap=True)  # disabled
