# Grasshopper definition japan_b.gh (Grasshopper 0.9.76)

座面_背もたれ厚さ = Slider(3, range=1..3, expression="x*10")
背もたれ上端高さ = Slider(4, range=1..4, expression="x*100")
背もたれ高さ = Slider(-1, range=-3..-1, expression="x*100")
基本奥行 = Slider(3, range=2..3, expression="x*200")
座面高さ = Slider(5, range=3..5, expression="x*100")
パイプ径 = Slider(3, range=1..3, expression="x*10")
基本幅 = Slider(8, range=4..8, expression="x*100")
rectangle = Rectangle(Plane=PlaneXY(0, 0, 0), XSize=基本幅, YSize=基本奥行, Radius=0)  # -> Rectangle, Length
debrep = DeconstructBrep(Brep=rectangle.Rectangle)  # -> Faces, Edges, Vertices
graft = GraftTree(Tree=debrep.Vertices, IncludeEmptyLists=True, IncludeNullItems=True)  # -> simplify(Tree)
bang = ExplodeTree(Data=graft)  # -> Branch0, Branch1, Branch2, Branch3
entwine = Entwine(Branch00=bang.Branch0, Branch01=bang.Branch1, Branch02=bang.Branch2, Branch03=bang.Branch3, FlattenInputs=True)  # -> flatten(Result)
intcrv = Interpolate(Vertices=entwine, Degree=3, Periodic=False, KnotStyle=1)  # -> Curve, Length, Domain
pt = Point(flatten([bang.Branch1, bang.Branch2]))
crv_cp = CurveClosestPoint(Point=pt, Curve=intcrv.Curve)  # -> Point, Parameter, Distance
Z = UnitZ(Factor=座面高さ)
shatter = Shatter(Curve=intcrv.Curve, Parameters=crv_cp.Parameter)
addition = Addition(A=座面高さ, B=背もたれ上端高さ)
move = Move(Geometry=rectangle.Rectangle, Motion=Z)  # -> Geometry, Transform
bang_2 = ExplodeTree(Data=graft(shatter))  # -> Branch0, Branch1, Branch2
Z_2 = UnitZ(Factor=addition)
division = Division(A=パイプ径, B=1)
cir = Circle(Plane=graft, Radius=パイプ径)
move_2 = Move(Geometry=intcrv.Curve, Motion=Z_2)  # -> Geometry, Transform
crv = Curve(bang_2.Branch1)
Z_3 = UnitZ(Factor=座面_背もたれ厚さ)
boundary = BoundarySurfaces(Edges=move.Geometry)
multiplication = Multiplication(A=座面_背もたれ厚さ, B=-1)
move_3 = Move(Geometry=crv, Motion=Z_2)  # -> Geometry, Transform
Z_4 = UnitZ(Factor=背もたれ高さ)
Y = UnitY(Factor=multiplication)
extr = Extrude(Base=move_3.Geometry, Direction=Z_4)
extr_2 = Extrude(Base=cir, Direction=Z_2)
cap = CapHoles(Brep=extr_2)
pipe = Pipe(Curve=move_2.Geometry, Radius=パイプ径, Caps=2)
extr_3 = Extrude(Base=boundary, Direction=Z_3)
extr_4 = Extrude(Base=extr, Direction=Y)

brep = Brep(<brep referenced from the Rhino model>)  # disabled
bbox = BoundingBox(Content=brep, Plane=PlaneXY(0, 0, 0))  # -> Box, Box_2; disabled
number_slider = Slider(6, range=0..20)  # disabled
debrep_2 = DeconstructBrep(Brep=bbox.Box)  # -> Faces, Edges, Vertices; disabled
item = ListItem(List=debrep_2.Vertices, Index=number_slider, Wrap=True)  # disabled

brep_2 = Brep([extr_3, cap, pipe, extr_4])
